% Simulink data dictionary data.sldd

FixedPointTypeVec = [1 16 0]
SawWavePrev = Simulink.Signal(DataType="single")
VCOSignal = Simulink.Signal()
isFixed = Simulink.Parameter(false, DataType="boolean")
VCOFrequency = Simulink.Parameter(441, DataType="single")
FilterEq_Resonance = Simulink.Parameter(1, DataType="single")
FilterEq_Cutoff_LFO = Simulink.Signal()
FilterEq_Resonance_LFO = Simulink.Signal()
FilterEq_Cutoff = Simulink.Parameter(1500, DataType="single")
SampleRate = Simulink.Parameter(48000)
BlockSize = Simulink.Parameter(64, DataType="single")
SampleTime = Simulink.Parameter(2.083333e-05)
VcoDutyMin = Simulink.Parameter(0.99, DataType="double")
VcoDutyMax = Simulink.Parameter(0.99, DataType="double")
VcoSignalRaw = Simulink.Signal()
VcoWaveformSelectionFadeRate = Simulink.Parameter(1, Unit="Hz")
VcoPhase = Simulink.Signal()
ControlRate = Simulink.Parameter(1000)
HALF = Simulink.Parameter(0.5, DataType="single")
ONE = Simulink.Parameter(1, StorageClass="Define", DataType="single")
ZERO = Simulink.Parameter(0, StorageClass="Define", DataType="single")
StopTime = 2
LfoPhase = Simulink.Signal()
TWO_PI = Simulink.Parameter(6.283185, DataType="single")
LfoGeneratedWave = Simulink.Signal()
COMPORT = Simulink.Parameter("COM9", DataType="string")
CodeGen_Config = Simulink.ConfigSet(StartTime="0", StopTime="StopTime", FixedStep="SampleTime", Solver="FixedStepAuto", ProdHWDeviceType="ARM Compatible->ARM Cortex", SystemTargetFile="ert.tlc", HardwareBoard="NXP MIMXRT1062xxxxA", TargetLang="C")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
Test_Config = Simulink.ConfigSet(StartTime="0", StopTime="StopTime", FixedStep="SampleTime", Solver="FixedStepAuto", ProdHWDeviceType="ARM Compatible->ARM Cortex", SystemTargetFile="ert.tlc", HardwareBoard="NXP MIMXRT1062xxxxA", TargetLang="C")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
Reference_Config = Simulink.ConfigSetRef()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